# Grasshopper definition AddTwoNumbers.gh (Grasshopper 1.0.8)

number_slider = Slider(0.5, range=0..10)
A = GetNumber(number_slider, AtLeast=1, AtMost=1, Maximum=1.797693135e+308, Minimum=-1.797693135e+308, TreeAccess=False)
B = GetNumber(number_slider, AtLeast=1, AtMost=1, Maximum=1.797693135e+308, Minimum=-1.797693135e+308, TreeAccess=False)
addition = Addition(A=A, B=B)
context_print = ContextPrint(Text=addition)
